# Dynamo graph Sheet Numbering Graph.dyn (Dynamo 1.3.0.875)

categories = Categories("Sheets")
all_elements_of_category = ElementsOfCategory(categories)

# group: Populates "SheetPosition" parameter with current index in list.
code_block = CodeBlock { "SheetPosition"; }
getParameterValueByName = Element.GetParameterValueByName(element=all_elements_of_category, parameterName=code_block)
count = Count(getParameterValueByName)
code_block_2 = CodeBlock(X=count) { 1..X; }
watch = Watch(code_block_2)
setParameterByName = Element.SetParameterByName(element=all_elements_of_category, parameterName=code_block, value=watch)

# group: Populates SheetTotal parameter with total number of items in list.
count_2 = Count(all_elements_of_category)
watch_2 = Watch(count_2)
code_block_3 = CodeBlock { "SheetTotal"; }
setParameterByName_2 = Element.SetParameterByName(element=all_elements_of_category, parameterName=code_block_3, value=count_2)
