# Dynamo graph Create Sheet Set (x).dyn (Dynamo 1.0.0.1180)

categories = Categories("Sheets")
# note: This workflow was created by BIMextension.com. Use at your own risk.
# Refer to http://bimextension.com/drawing-lists-in…ather-than-excel/ for a write up.
all_elements_of_category = ElementsOfCategory(categories)
code_block = CodeBlock { "Set - TI - 100%DD"; }
getParameterValueByName = Element.GetParameterValueByName(element=all_elements_of_category, parameterName=code_block)
string = StringInput("x")
contains = String.Contains(str=getParameterValueByName, searchFor=string)
filterByBoolMask = List.FilterByBoolMask(list=all_elements_of_category, mask=contains)

# group: MAGIC
python_script = Python(IN[0]=filterByBoolMask.in, IN[1]=code_block)
# ---------- python_script.python (52 lines) ----------
import clr
clr.AddReference('ProtoGeometry')
from Autodesk.DesignScript.Geometry import *

clr.AddReference('RevitAPI')
import Autodesk
from Autodesk.Revit.DB import *

clr.AddReference('RevitServices')
import RevitServices
from RevitServices.Persistence import DocumentManager
from RevitServices.Transactions import TransactionManager

doc = DocumentManager.Instance.CurrentDBDocument

sheets = IN[0]
sheetSetName = IN[1]

viewSet = ViewSet()

# try to add all of the sheets to the set
try:
 	for vs in sheets:
 		view = UnwrapElement(vs)
 		viewSet.Insert(view)
# If there’s one item in the set, just add the one
except:
 	view = UnwrapElement(sheets)
 	viewSet.Insert(view)

# Get the printmanager to add the view set to.
printManager = doc.PrintManager
printManager.PrintRange = PrintRange.Select

# create the ViewSheetSetting to append the viewset.
viewSheetSetting = printManager.ViewSheetSetting
viewSheetSetting.CurrentViewSheetSet.Views = viewSet

# Create the Sheet Set
trans = Transaction(doc, 'Create View/Sheet Set')

TransactionManager.Instance.ForceCloseTransaction()
trans.Start()
try:
 	viewSheetSetting.SaveAs(sheetSetName)
 	msg = 'Sheet set ' + sheetSetName + ' created.'
except:
 	msg = 'Failed to create sheet set'
trans.Commit()

#Assign your output to the OUT variable
OUT = msg
# ----------------------------------------
