# Dynamo graph 3D_View_Batch_Generator.dyn (Dynamo 1.3.0.875)

# group: INPUT
code_block = CodeBlock { "DESIGN_GENERATE_3D_VIEW"; }
precisionDigits = CodeBlock { 0; }
n3d_view_prefix = StringInput("PREFIX_")  # "3D View Prefix"
n3d_view_postfix = StringInput("_POSTFIX")  # "3D View Postfix"
code_block_2 = CodeBlock { "VIEWS_BROWSER_FOLDER"; }
revitSubDiscipline = CodeBlock { "DESIGN_3D"; }
image_size = CodeBlock { 620; 480; }
select_rendertype = RenderTypeDropDown("Image")
select_renderquality = RenderQualityDropDown("Draft")
output_folder = CodeBlock { "C:\\Users\\NexusAEC\\Desktop\\DynamoDemo\\RenderingOutputFolder"; }

# group: Select all Rooms and Spaces and create a Clean List
categories = Categories("Rooms")
all_elements_of_category = ElementsOfCategory(categories)
categories_2 = Categories("MEPSpaces")
all_elements_of_category_2 = ElementsOfCategory(categories_2)
join = List.Join(all_elements_of_category, all_elements_of_category_2)
code_block_3 = CodeBlock(b=code_block) { b; }
getParameterValueByName = Element.GetParameterValueByName(element=join, parameterName=code_block_3)
boolean = BoolSelector(true)
eq = getParameterValueByName == boolean
filterByBoolMask = List.FilterByBoolMask(list=join, mask=eq)
clean = List.Clean(list=filterByBoolMask.in)

# group: Generate eyePoint and target
getLocation = Element.GetLocation(clean)
X = Point.X(getLocation)
code_block_4 = CodeBlock(precision=precisionDigits)
# ---------- code_block_4.designscript (4 lines) ----------
2;
//For Dividing by 2;
precision;
//For Number of Digits to round;
# ----------------------------------------
round = Math.Round(number=X, digits=code_block_4.precision)
Y = Point.Y(getLocation)
round_2 = Math.Round(number=Y, digits=code_block_4.precision)
boundingBox = Element.BoundingBox(clean)
maxPoint = BoundingBox.MaxPoint(boundingBox)
Z = Point.Z(maxPoint)
round_3 = Math.Round(number=Z, digits=code_block_4.precision)
n2 = round_3 / code_block_4.out0  # "/2"
minPoint = BoundingBox.MinPoint(boundingBox)
Z_2 = Point.Z(minPoint)
round_4 = Math.Round(number=Z_2, digits=code_block_4.precision)
add = n2 + round_4
round_5 = Math.Round(number=add, digits=code_block_4.precision)
byCoordinates = Point.ByCoordinates(x=round, y=round_2, z=round_5)
X_2 = Point.X(minPoint)
round_6 = Math.Round(number=X_2, digits=code_block_4.precision)
Y_2 = Point.Y(minPoint)
round_7 = Math.Round(number=Y_2, digits=code_block_4.precision)
byCoordinates_2 = Point.ByCoordinates(x=round_6, y=round_7, z=round_4)
convert_between_units = DynamoConvert(conversionMetric=Length, conversionFrom=Meters, conversionTo=Meters)

# group: Create the 3D View's name from the user defined Prefix the Name, Number and Postfix
code_block_5 = CodeBlock { "Name"; "Number"; "_"; }
getParameterValueByName_2 = Element.GetParameterValueByName(element=clean, parameterName=code_block_5.out0)
getParameterValueByName_3 = Element.GetParameterValueByName(element=clean, parameterName=code_block_5.out1)
create = List.Create(getParameterValueByName_2, getParameterValueByName_3)
transpose = List.Transpose(create)
join_2 = String.Join(code_block_5.out2, transpose)
code_block_6 = CodeBlock { 0; }
insert = String.Insert(str=join_2, index=code_block_6, toInsert=n3d_view_prefix)
length = String.Length(insert)
insert_2 = String.Insert(str=insert, index=length, toInsert=n3d_view_postfix)

# group: Calculate the hypotenuse between the eyepoint and the target
pow = Math.Pow(number=round, power=code_block_4.out0)
pow_2 = Math.Pow(number=round_2, power=code_block_4.out0)
add_2 = pow + pow_2
sqrt = Math.Sqrt(add_2)
pow_3 = Math.Pow(number=round_6, power=code_block_4.out0)
pow_4 = Math.Pow(number=round_7, power=code_block_4.out0)
add_3 = pow_3 + pow_4
sqrt_2 = Math.Sqrt(add_3)
sub = sqrt - sqrt_2

# group: Create 3D View
code_block_7 = CodeBlock(ViewSortParam=code_block_2) { false; "Far Clip Offset"; ViewSortParam; "View Name"; }
byEyePointTargetAndBoundingBox = PerspectiveView.ByEyePointTargetAndBoundingBox(byCoordinates, byCoordinates_2, boundingBox, insert_2, code_block_7.out0)
flatten = Flatten(byEyePointTargetAndBoundingBox)
setParameterByName = Element.SetParameterByName(element=flatten, parameterName=code_block_7.out1, value=sub)
setParameterByName_2 = Element.SetParameterByName(element=setParameterByName, parameterName=code_block_7.ViewSortParam, value=revitSubDiscipline)

getParameterValueByName_4 = Element.GetParameterValueByName(element=setParameterByName_2, parameterName=code_block_7.out3)
count = Count(setParameterByName_2)
cycle = List.Cycle(list=image_size.out0, amount=count)
cycle_2 = List.Cycle(list=image_size.out1, amount=count)
cycle_3 = List.Cycle(list=select_rendertype, amount=count)
cycle_4 = List.Cycle(list=select_renderquality, amount=count)

# group: Push job to cloud and render
export_cloud_render_data = ExportDocumentRenderData(setParameterByName_2)
upload_cloud_render_data = UploadRenderData(export_cloud_render_data)
byViewNameWidthHeight = Analyze.Render.CloudRenderingJob.ByViewNameWidthHeight(getParameterValueByName_4, cycle, cycle_2, cycle_3, cycle_4)
code_block_8 = CodeBlock { true; }
do_cloud_render = CloudRender(upload_cloud_render_data, byViewNameWidthHeight, code_block_8, output_folder)

code_block_9 = CodeBlock()  # //TODO:Get access to create stereoscopic 3D Renderings
