# Dynamo graph RoomDataSheets.dyn (Dynamo 1.3.0.875)

# group: Select All Spaces
categories = Categories("MEPSpaces")
all_elements_of_category = ElementsOfCategory(categories)

# group: Select All Rooms
categories_2 = Categories("Rooms")
all_elements_of_category_2 = ElementsOfCategory(categories_2)

join = List.Join(all_elements_of_category, all_elements_of_category_2)
code_block = CodeBlock { "Name"; "Number"; "-"; "RDS_"; 0; 4; "_3D"; " "; "_"; "z_ADMIN_AUTO_GENERATE_3D"; }

# group: Filter out spaces with empty names AND without z_ADMIN_AUTO_GENERATE_3D checkbox checked
get_the_name = Element.GetParameterValueByName(element=join, parameterName=code_block.out0)
length = String.Length(get_the_name)
gt = length > code_block.out4
filterByBoolMask = List.FilterByBoolMask(list=join, mask=gt)
code_block_2 = CodeBlock { "Unoccupied"; }

get_z_admin_auto_generate_3d = Element.GetParameterValueByName(element=filterByBoolMask.in, parameterName=code_block.out9)
code_block_3 = CodeBlock { true; }
eq = get_z_admin_auto_generate_3d == code_block_3
filterByBoolMask_2 = List.FilterByBoolMask(list=filterByBoolMask.in, mask=eq)
get_the_name_2 = Element.GetParameterValueByName(element=filterByBoolMask_2.in, parameterName=code_block.out0)

# group (continued): Filter out spaces with empty names AND without z_ADMIN_AUTO_GENERATE_3D checkbox checked
contains = String.Contains(str=get_the_name_2, searchFor=code_block_2)
not_ = Not(contains)
filterByBoolMask_3 = List.FilterByBoolMask(list=filterByBoolMask_2.in, mask=not_)

# group: Create base view name
get_space_name = Element.GetParameterValueByName(element=filterByBoolMask_3.in, parameterName=code_block.out0)
insert = String.Insert(str=code_block.out3, index=code_block.out5, toInsert=get_space_name)
length_2 = String.Length(insert)
insert_2 = String.Insert(str=insert, index=length_2, toInsert=code_block.out2)
length_3 = String.Length(insert_2)
get_space_number = Element.GetParameterValueByName(element=filterByBoolMask_3.in, parameterName=code_block.out1)
insert_3 = String.Insert(str=insert_2, index=length_3, toInsert=get_space_number)
replace = String.Replace(str=insert_3, searchFor=code_block.out7, replaceWith=code_block.out8)

# group: Add "_3D" to end of base view name
length_4 = String.Length(replace)
code_block_4 = CodeBlock { "_3D"; }
insert_4 = String.Insert(str=replace, index=length_4, toInsert=code_block_4)

# group: Generate 3D View
code_block_5 = CodeBlock { 0.5; 3; }
boundingBox = Element.BoundingBox(filterByBoolMask_3.in)
minPoint = BoundingBox.MinPoint(boundingBox)
X = ReferencePoint.X(minPoint)
maxPoint = BoundingBox.MaxPoint(boundingBox)
X_2 = ReferencePoint.X(maxPoint)
add = X + X_2
mul = code_block_5.out0 * add
Y = ReferencePoint.Y(minPoint)
Y_2 = ReferencePoint.Y(maxPoint)
add_2 = Y + Y_2
mul_2 = code_block_5.out0 * add_2
Z = ReferencePoint.Z(minPoint)
Z_2 = ReferencePoint.Z(maxPoint)
add_3 = Z + Z_2
mul_3 = code_block_5.out0 * add_3
code_block_6 = CodeBlock { false; }
code_block_7 = CodeBlock { "Design_RDS_3D"; "View Name"; "Far Clip Offset"; "Phase"; }

add_4 = code_block_5.out1 + mul_3

# group (continued): Generate 3D View
byCoordinates = Point.ByCoordinates(x=mul, y=mul_2, z=add_4)
byEyePointTargetAndBoundingBox = PerspectiveView.ByEyePointTargetAndBoundingBox(byCoordinates, minPoint, boundingBox, insert_4, code_block_6)
cropView = Custom[View.CropView](Views=byEyePointTargetAndBoundingBox)  # Crop a 3D view

flatten = Flatten(cropView)

# group (continued): Generate 3D View
applyViewTemplate = Custom[View.ApplyViewTemplate](View_s=flatten, View_Template_Name=code_block_7.out0)  # Applies a view template to any given view(s). Supply a string with a view template name.
getParameterValueByName = Element.GetParameterValueByName(element=flatten, parameterName=code_block_7.out1)

parameters = Element.Parameters(applyViewTemplate)

# group: Render 3D View on cloud
select_skymodeltype = SkyModelTypeDropDown("Render")
export_cloud_render_data = ExportDocumentRenderData(flatten)
upload_cloud_render_data = UploadRenderData(export_cloud_render_data)
imageWidth = IntegerSlider(640, range=0..10000 step 1)
imageHeight = IntegerSlider(480, range=0..10000 step 1)
select_rendertype = RenderTypeDropDown("Panorama")
select_renderquality = RenderQualityDropDown("Draft")
byViewNameWidthHeight = Analyze.Render.CloudRenderingJob.ByViewNameWidthHeight(getParameterValueByName, imageWidth, imageHeight, select_rendertype, select_renderquality)
boolean = BoolSelector(true)

clean = List.Clean(list=upload_cloud_render_data)
clean_2 = List.Clean(list=byViewNameWidthHeight)

# group (continued): Render 3D View on cloud
do_cloud_render = CloudRender(clean, clean_2, boolean)

basePoint = Coordinates.BasePoint()
watch = Watch(basePoint)
projectRotation = Coordinates.ProjectRotation()
watch_2 = Watch(projectRotation)
surveyPoint = Coordinates.SurveyPoint()
watch_3 = Watch(surveyPoint)
isEmpty = List.IsEmpty(all_elements_of_category)
isEmpty_2 = List.IsEmpty(all_elements_of_category_2)
number_slider = DoubleSlider(30, range=0..100 step 0.1)
setParameterByName = Element.SetParameterByName(element=applyViewTemplate, parameterName=code_block_7.out2, value=number_slider)
getParameterValueByName_2 = Element.GetParameterValueByName(element=filterByBoolMask_3.in, parameterName=code_block_7.out3)
setParameterByName_2 = Element.SetParameterByName(element=setParameterByName, parameterName=code_block_7.out3, value=getParameterValueByName_2)
