# Dynamo graph Bootstrap.dyn (Dynamo 1.3.1.1736)

string = StringInput(".\BootstrapTest.html")

# group: Set external CSS
string_2 = StringInput("https://maxcdn.bootstrapcdn.com/bootstrap/3.3.7/css/bootstrap.min.css")
create = List.Create(string_2)

# group: Set external javascript
string_3 = StringInput("https://ajax.googleapis.com/ajax/libs/jquery/3.2.0/jquery.min.js")
string_4 = StringInput("https://maxcdn.bootstrapcdn.com/bootstrap/3.3.7/js/bootstrap.min.js")
string_5 = StringInput("https://www.gstatic.com/charts/loader.js")
create_2 = List.Create(string_3, string_4, string_5)

string_6 = StringInput("""<style>
iframe {
min-height: 700px;
width: 100%;
border: 0;
}
</style>""")
string_7 = StringInput("\n")
string_8 = StringInput("<h1>Dashboard</h1>")
string_9 = StringInput("""<div class="panel panel-default">
<div class="panel-body">
<iframe src ="./Ducts.html" scrolling="no">
</iframe>
</div>
</div>""")
string_10 = StringInput("<iframe src =\"./Air Terminals.html\" scrolling=\"no\"></iframe>")
bootstrap_row_6_6 = Custom[Bootstrap Row - 6-6](leftColumn=string_9, rightColumn=string_10)  # Generate HTML for a row of two equal columns for a Bootstrap page.
join = String.Join(string_7, string_8, bootstrap_row_6_6)
generate_web_page = Custom[Generate Web Page](stylesheetSrc=create, javaScriptSrc=create_2, embeddedHeadCode=string_6, content=join)  # Creates a static web page from a string formatted as HTML.
writeText = File.WriteText(string, generate_web_page)
string_11 = StringInput("Project Dashboard")
