# Dynamo graph Google Charts - Bar.dyn (Dynamo 1.3.1.1736)

categories = Categories("DuctTerminal")
data_set_quantities_of_family = Custom[Data Set - Quantities of Family Types](category=categories)  # Creates a list of family types for a category with wublists containing the family type name and quantity.
generate_web_page_google_bar = Custom[Generate Web Page - Google Bar Chart](items=data_set_quantities_of_family)  # Generate HTML code for a web page to display a bar chart using Google Charts.
watch = Watch(generate_web_page_google_bar)
file_path = Filename("Mechanical Dashboard\Air Terminals.html")
writeText = File.WriteText(file_path, generate_web_page_google_bar)
