# Dynamo graph Google Charts - Pie.dyn (Dynamo 1.3.1.1736)

file_path = Filename("Mechanical Dashboard\Ducts.html")
categories = Categories("DuctCurves")

# group: Package: BIMxHTML
data_set_quantities_of_family = Custom[Data Set - Quantities of Family Types](category=categories)  # Creates a list of family types for a category with wublists containing the family type name and quantity.

# group: Package: BIMxHTML
generate_web_page_google_pie = Custom[Generate Web Page - Google Pie Chart](items=data_set_quantities_of_family)  # Generates the HTML code for a web page that displays a responsive Google Pie Chart.

writeText = File.WriteText(file_path, generate_web_page_google_pie)
watch = Watch(generate_web_page_google_pie)
