# Dynamo graph Generate HTML Schedule - All Parameters.dyn (Dynamo 1.3.1.1736)

# group: Set external CSS
string = StringInput("css/bootstrap.min.css")
string_2 = StringInput("css/excel-bootstrap-table-filter-style.css")
create = List.Create(string, string_2)

# group: Set external javascript
string_3 = StringInput("js/jquery.min.js")
string_4 = StringInput("js/bootstrap.min.js")
string_5 = StringInput("js/excel-bootstrap-table-filter-bundle.js")
create_2 = List.Create(string_3, string_4, string_5)

# group: Add embedded HTML for head
string_embedded_css_or_js = StringInput("")

categories = Categories("MechanicalEquipment")

# group: Create page title
code_block = CodeBlock(category=categories) { "<h1>List of " + category + "</h1>"; }

all_elements_of_category = ElementsOfCategory(categories)
id = Element.Id(all_elements_of_category)
code_block_2 = CodeBlock { "Element Id"; "COBie.Component.Name"; "COBie.Component.Space"; "Level"; }
getParameterValueByName = Element.GetParameterValueByName(element=all_elements_of_category, parameterName=code_block_2.out1)
getParameterValueByName_2 = Element.GetParameterValueByName(element=all_elements_of_category, parameterName=code_block_2.out2)
getParameterValueByName_3 = Element.GetParameterValueByName(element=all_elements_of_category, parameterName=code_block_2.out3)
create_3 = List.Create(id, getParameterValueByName, getParameterValueByName_2, getParameterValueByName_3)
transpose = List.Transpose(create_3)
create_4 = List.Create(code_block_2.out0, code_block_2.out1, code_block_2.out2, code_block_2.out3)

# group: Create HTML code for table
string_table_classes = StringInput("table table-striped")
python_create_html_table = Python(IN[0]=transpose, IN[1]=string_table_classes, IN[2]=create_4)
# ---------- python_create_html_table.python (31 lines) ----------
import clr
clr.AddReference('ProtoGeometry')
from Autodesk.DesignScript.Geometry import *
#The inputs to this node will be stored as a list in the IN variables.
listIn = IN[0]
tableClasses = IN[1]
tableHeaders = IN[2]

html = ""

# Create table with classes
html += "<table class=\"" + tableClasses + "\"" + ">\n"

# Create table headers
html += "<thead>\n<tr>\n"
for index, i in enumerate(tableHeaders):
	html += '<th class="filter">' + tableHeaders[index] + '</th>\n'
html+= "</tr>\n"
html+= "</thead>\n"

html += "<tbody>\n"
for index, i in enumerate(listIn):
	html += "<tr> \n"
	for index2, i in enumerate(listIn[index]):
		html += "\t<td>" + str(listIn[index][index2]) + "</td> \n"
	html += "</tr> \n"
html += "</tbody>"
html += "</table>\n"

#Assign your output to the OUT variable.
OUT = html
# ----------------------------------------

# group: Additional HTML code
string_6 = StringInput(" ")
string_7 = StringInput("""  <script>
    // Use the plugin once the DOM has been loaded.
    $(function () {
      // Apply the plugin 
      $('.table').excelTableFilter();
    });
  </script>""")
join = String.Join(string_6, code_block, python_create_html_table, string_7)

# group: Select HTML file
file_path = Filename(".\Schedule-1.html")

# group: Write to external HTML file
generate_web_page = Custom[Generate Web Page](stylesheetSrc=create, javaScriptSrc=create_2, embeddedHeadCode=string_embedded_css_or_js, content=join)  # Creates a static web page from a string formatted as HTML.
watch = Watch(generate_web_page)
writeText = File.WriteText(file_path, generate_web_page)

file_path_2 = Filename(".\data.csv")
parameters = Element.Parameters(all_elements_of_category)

# group: Get parameter names
name = Parameter.Name(parameters)
watch_2 = Watch(name)

getParameterValueByName_4 = Element.GetParameterValueByName(element=all_elements_of_category, parameterName=watch_2)
watch_3 = Watch(getParameterValueByName_4)
writeToFile = CSV.WriteToFile(file_path_2, watch_3)

# group: Select HTML file
file_path_3 = Filename(".\Schedule-2.html")

# group: Set external CSS
string_8 = StringInput("css/bootstrap.min.css")
string_9 = StringInput("css/excel-bootstrap-table-filter-style.css")
create_5 = List.Create(string_8, string_9)

# group: Set external javascript
string_10 = StringInput("js/jquery.min.js")
string_11 = StringInput("js/bootstrap.min.js")
string_12 = StringInput("js/excel-bootstrap-table-filter-bundle.js")
create_6 = List.Create(string_10, string_11, string_12)

# group: Add embedded HTML for head
string_embedded_css_or_js_2 = StringInput("")

# group: Create a list of parameter names
code_block_3 = CodeBlock { "Element Id"; }
code_block_4 = CodeBlock { 1; }
flatten = List.Flatten(list=watch_2, amt=code_block_4)
uniqueItems = List.UniqueItems(flatten)
addItemToFront = List.AddItemToFront(item=code_block_3, list=uniqueItems)
watch_4 = Watch(addItemToFront)

watch_5 = Watch(parameters)
string_from_object = FromObject(watch_5)
python_script = Python(IN[0]=string_from_object)
# ---------- python_script.python (19 lines) ----------
import clr
clr.AddReference('ProtoGeometry')
from Autodesk.DesignScript.Geometry import *

import sys
sys.path.append(r'C:\Program Files (x86)\IronPython 2.7\DLLs')
sys.path.append(r'C:\Program Files (x86)\IronPython 2.7\Lib')

#The inputs to this node will be stored as a list in the IN variables.
params = IN[0]
newList = []

for index, l in enumerate(params):
	for index2, i in enumerate(params[index]):
		params[index][index2] = i.encode('utf-8').split(" : ")


#Assign your output to the OUT variable.
OUT = params
# ----------------------------------------
python_script_2 = Python(IN[0]=watch_4, IN[1]=python_script)
# ---------- python_script_2.python (53 lines) ----------
import clr
clr.AddReference('ProtoGeometry')
from Autodesk.DesignScript.Geometry import *
#The inputs to this node will be stored as a list in the IN variables.
names = UnwrapElement(IN[0])
namesWithValues = UnwrapElement(IN[1])

html = "<table>\n"

test = []

# Define column heads
html += '<tr>\n'
for i in names:
    html += '<th class="filter">' + str(i) + '</th>\n'
html += '</tr>\n'

for index, i in enumerate(namesWithValues[0]):
	html += '<tr>'
	html += str(i)
	html += '</tr'

# Define cell values
#for index, i in enumerate(namesWithValues):
#	for index2, j in enumerate(namesWithValues[index]):
#		
#		# Start new row for table cells
#		html += '<tr>\n'
#		
#		# Write cell value if the parameter name matches the table head
#		if namesWithValues[index][index2][0] == names[7]:
#			html += "<td>" + str(namesWithValues[index][index2][1]) + "</td>\n"
#		
#		# Render blank cell		
#		else:
#			html += "<td></td>\n"
#		
#		html += '</tr>'
	
    # if table matches column head, populate cell
    #if namesWithValues[index][0] == "Offset":
    #    html += "<td>" + str(namesWithValues[index][1]) + "</td>\n"
    
    # else print an empty cell
    #else:
    #    html += "<td></td>\n"

html += '</tr>\n'
html += "</table>"


#Assign your output to the OUT variable.
OUT = html
# ----------------------------------------

# group: Additional HTML code
string_13 = StringInput(" ")
string_14 = StringInput("""  <script>
    // Use the plugin once the DOM has been loaded.
    $(function () {
      // Apply the plugin 
      $('.table').excelTableFilter();
    });
  </script>""")
join_2 = String.Join(string_13, code_block, python_script_2, string_14)

# group: Write to external HTML file
generate_web_page_2 = Custom[Generate Web Page](stylesheetSrc=create_5, javaScriptSrc=create_6, embeddedHeadCode=string_embedded_css_or_js_2, content=join_2)
writeText_2 = File.WriteText(file_path_3, generate_web_page_2)
watch_6 = Watch(generate_web_page_2)

# group: Create HTML code for table
string_table_classes_2 = StringInput("table table-striped")
python_create_html_table_2 = Python(IN[0]=transpose, IN[1]=string_table_classes_2, IN[2]=watch_4)  # same code as python_create_html_table

code_block_5 = CodeBlock { "Element Id"; "COBie.Component.Name"; "COBie.Component.Space"; "Level"; "System Classification"; }
create_7 = List.Create(code_block_5.out1, code_block_5.out2, code_block_5.out3, code_block_5.out4)
python_script_3 = Python(IN[0]=all_elements_of_category, IN[1]=create_7)
# ---------- python_script_3.python (71 lines) ----------
#Copyright (c) 2014, Nathan Miller
#The Proving Ground http://theprovingground.org

# Default imports
import clr

# Import RevitAPI
clr.AddReference("RevitAPI")
import Autodesk
from Autodesk.Revit.DB import *

# Import DocumentManager and TransactionManager
clr.AddReference("RevitServices")
import RevitServices
from RevitServices.Persistence import DocumentManager
from RevitServices.Transactions import TransactionManager

# Import ToDSType(bool) extension method
clr.AddReference("RevitNodes")
import Revit
clr.ImportExtensions(Revit.Elements)

#The input to this node will be stored in the IN[0] variable.

doc =  DocumentManager.Instance.CurrentDBDocument
app =  DocumentManager.Instance.CurrentUIApplication.Application

elements = UnwrapElement(IN[0])
parameters = IN[1]

params = []
output = []

for elem in elements:
	for p in elem.Parameters:
		if p.Definition.Name == parameters[2]:
			output.append(p.AsValueString())

for elem in elements:
	params.append(LookupParameter(elem))

#if hasattr(elements, "__iter__"):
#	output = []
#	for elem in elements:
#		if hasattr(elem, "__iter__"):
#			vals = []
#			for e in elem:
#				for p in elem.Parameters:
#					for i in parameters:
#						if p.Definition.Name == i:		
#							output.append(p.AsValueString())
#						if (parm is None):
#							parm = p.AsString()
#				vals.append(parm)
#			values.append(vals)
#		else:
#			for p in elem.Parameters:
#				if p.Definition.Name == parameter:		
#					parm = p.AsValueString()
#					if (parm is None):
#							parm = p.AsString()
#			values.append(parm)
#	output.append(values)
#else:
#	parm = 	elements.Parameter[parameter].AsValueString()
#	output = parms



#Assign your output to the OUT variable
OUT = params
# ----------------------------------------
