# Dynamo graph Generate HTML Schedule - Specific Parameters.dyn (Dynamo 1.3.1.1736)

# group: Set external CSS
string = StringInput("css/bootstrap.min.css")
string_2 = StringInput("css/excel-bootstrap-table-filter-style.css")
create = List.Create(string, string_2)

# group: Set external javascript
string_3 = StringInput("js/jquery.min.js")
string_4 = StringInput("js/bootstrap.min.js")
string_5 = StringInput("js/excel-bootstrap-table-filter-bundle.js")
create_2 = List.Create(string_3, string_4, string_5)

# group: Add embedded HTML for head
string_embedded_css_or_js = StringInput("")

code_block = CodeBlock { "Element Id"; "Number"; "Name"; "Level"; }

# group: Get list of parameter values
categories = Categories("MechanicalEquipment")
all_elements_of_category = ElementsOfCategory(categories)
id = Element.Id(all_elements_of_category)
getParameterValueByName = Element.GetParameterValueByName(element=all_elements_of_category, parameterName=code_block.out1)
getParameterValueByName_2 = Element.GetParameterValueByName(element=all_elements_of_category, parameterName=code_block.out2)
getParameterValueByName_3 = Element.GetParameterValueByName(element=all_elements_of_category, parameterName=code_block.out3)
create_3 = List.Create(id, getParameterValueByName, getParameterValueByName_2, getParameterValueByName_3)
transpose = List.Transpose(create_3)

# group: Create page title
code_block_2 = CodeBlock(category=categories) { "<h1>List of " + category + "</h1>"; }

create_4 = List.Create(code_block.out0, code_block.out1, code_block.out2, code_block.out3)

# group: Create HTML code for table
string_table_classes = StringInput("table table-striped")
python_create_html_table = Python(IN[0]=transpose, IN[1]=string_table_classes, IN[2]=create_4)
# ---------- python_create_html_table.python (31 lines) ----------
import clr
clr.AddReference('ProtoGeometry')
from Autodesk.DesignScript.Geometry import *
#The inputs to this node will be stored as a list in the IN variables.
listIn = IN[0]
tableClasses = IN[1]
tableHeaders = IN[2]

html = ""

# Create table with classes
html += "<table class=\"" + tableClasses + "\"" + ">\n"

# Create table headers
html += "<thead>\n<tr>\n"
for index, i in enumerate(tableHeaders):
	html += '<th class="filter">' + tableHeaders[index] + '</th>\n'
html+= "</tr>\n"
html+= "</thead>\n"

html += "<tbody>\n"
for index, i in enumerate(listIn):
	html += "<tr> \n"
	for index2, i in enumerate(listIn[index]):
		html += "\t<td>" + str(listIn[index][index2]) + "</td> \n"
	html += "</tr> \n"
html += "</tbody>"
html += "</table>\n"

#Assign your output to the OUT variable.
OUT = html
# ----------------------------------------

# group: Additional HTML code
string_6 = StringInput(" ")
string_7 = StringInput("""  <script>
    // Use the plugin once the DOM has been loaded.
    $(function () {
      // Apply the plugin 
      $('.table').excelTableFilter();
    });
  </script>""")
join = String.Join(string_6, code_block_2, python_create_html_table, string_7)

# group: Select HTML file
file_path = Filename(".\Schedule-1.html")

# group: Write to external HTML file
generate_web_page = Custom[Generate Web Page](stylesheetSrc=create, javaScriptSrc=create_2, embeddedHeadCode=string_embedded_css_or_js, content=join)  # Creates a static web page from a string formatted as HTML.
watch = Watch(generate_web_page)
writeText = File.WriteText(file_path, generate_web_page)
