# Dynamo graph Table Sample.dyn (Dynamo 1.3.1.1736)

# group: Set external CSS
string = StringInput("https://maxcdn.bootstrapcdn.com/bootstrap/3.3.7/css/bootstrap.min.css")
create = List.Create(string)

# group: Set external javascript
string_2 = StringInput("https://ajax.googleapis.com/ajax/libs/jquery/3.2.0/jquery.min.js")
string_3 = StringInput("https://maxcdn.bootstrapcdn.com/bootstrap/3.3.7/js/bootstrap.min.js")
create_2 = List.Create(string_2, string_3)

# group: Add embedded HTML for head
string_embedded_css_or_js = StringInput("")

# group: Get list of parameter values
categories = Categories("Rooms")
all_elements_of_category = ElementsOfCategory(categories)
id = Element.Id(all_elements_of_category)
code_block = CodeBlock { "Number"; "Name"; "Level"; }
getParameterValueByName = Element.GetParameterValueByName(element=all_elements_of_category, parameterName=code_block.out0)
getParameterValueByName_2 = Element.GetParameterValueByName(element=all_elements_of_category, parameterName=code_block.out1)
getParameterValueByName_3 = Element.GetParameterValueByName(element=all_elements_of_category, parameterName=code_block.out2)
python_script = Python(IN[0]=id, IN[1]=getParameterValueByName, IN[2]=getParameterValueByName_2, IN[3]=getParameterValueByName_3)
# ---------- python_script.python (13 lines) ----------
import clr
clr.AddReference('ProtoGeometry')
from Autodesk.DesignScript.Geometry import *
#The inputs to this node will be stored as a list in the IN variables.
elementIds = IN[0]
parameterA = IN[1]
parameterB = IN[2]
parameterC = IN[3]

listParams = zip(elementIds, parameterA, parameterB, parameterC)

#Assign your output to the OUT variable.
OUT = listParams
# ----------------------------------------

code_block_2 = CodeBlock(category=categories) { "<h1>List of " + category + "</h1>"; }

# group: Create HTML code for table
string_table_classes = StringInput("table table-striped")
python_create_html_table = Python(IN[0]=python_script, IN[1]=string_table_classes)
# ---------- python_create_html_table.python (21 lines) ----------
import clr
clr.AddReference('ProtoGeometry')
from Autodesk.DesignScript.Geometry import *
#The inputs to this node will be stored as a list in the IN variables.
listIn = IN[0]
tableClasses = IN[1]

html = ""

html += "<table class=\"" + tableClasses + "\"" + ">\n"
html += "<tbody>\n"
for index, i in enumerate(listIn):
	html += "<tr> \n"
	for index2, i in enumerate(listIn[index]):
		html += "\t<td>" + str(listIn[index][index2]) + "</td> \n"
	html += "</tr> \n"
html += "</tbody>"
html += "</table>\n"

#Assign your output to the OUT variable.
OUT = html
# ----------------------------------------

# group: Additional HTML code
string_4 = StringInput("\n")
join = String.Join(string_4, code_block_2, python_create_html_table)

file_path = Filename("..\..\..\..\Amazon Drive\Business\BIM Extension\Test Projects\Praire Sky East Dormitory\Working\HTML\Rooms.html")

# group: Write to external HTML file
generate_web_page = Custom[Generate Web Page](stylesheetSrc=create, javaScriptSrc=create_2, embeddedHeadCode=string_embedded_css_or_js, content=join)  # Creates a static web page from a string formatted as HTML.
watch = Watch(generate_web_page)
writeText = File.WriteText(file_path, generate_web_page)
