# Dynamo graph Google Charts - Pie Chart.dyn (Dynamo 1.3.1.1736)

# group: Set external CSS
string = StringInput("https://maxcdn.bootstrapcdn.com/bootstrap/3.3.7/css/bootstrap.min.css")
create = List.Create(string)

# group: Set external javascript
string_2 = StringInput("https://ajax.googleapis.com/ajax/libs/jquery/3.2.0/jquery.min.js")
string_3 = StringInput("https://maxcdn.bootstrapcdn.com/bootstrap/3.3.7/js/bootstrap.min.js")
string_4 = StringInput("https://www.gstatic.com/charts/loader.js")
string_5 = StringInput("https://rawgit.com/louisremi/jquery-smartresize/master/jquery.throttledresize.js")
string_6 = StringInput("https://www.google.com/jsapi?ext.js")
create_2 = List.Create(string_2, string_3, string_4, string_5, string_6)

string_7 = StringInput("""<script type="text/javascript">
google.load("visualization", "1", {
    packages: ["corechart"]
});
google.setOnLoadCallback(initChart);

$(window).on("throttledresize", function (event) {
    initChart();
});




""")
string_8 = StringInput("""function initChart() {
    var options = {""")
categories = Categories("DuctCurves")
string_from_object = FromObject(categories)
code_block = CodeBlock(x=string_from_object) { "title:'" + x + " By Type',"; }
string_9 = StringInput("        width: '100%',\n        height: '100%',\nlegend: {position: 'bottom'},\n        pieSliceText: 'percentage',\n        chartArea: {\n            left: \"3%\",\n            top: \"3%\",\n            height: \"94%\",\n            width: \"94%\"")
string_10 = StringInput("""        }
    };""")
string_11 = StringInput("    var data = google.visualization.arrayToDataTable([")
data_set_quantities_of_family = Custom[Data Set - Quantities of Family Types](category=categories)  # Creates a list of family types for a category with wublists containing the family type name and quantity.
watch = Watch(data_set_quantities_of_family)

# group: Create rows for JavaScript
python_add_js_rows = Python(IN[0]=watch)
# ---------- python_add_js_rows.python (13 lines) ----------
import clr
clr.AddReference('ProtoGeometry')
from Autodesk.DesignScript.Geometry import *
#The inputs to this node will be stored as a list in the IN variables.
dictIn = IN[0]

javaScript = "['Family Type','Quantity'],\n"

for index, i in enumerate(dictIn):
	javaScript += "\t" + str(dictIn[index]) + ",\n"
javaScript = javaScript[:-2]
#Assign your output to the OUT variable.
OUT = javaScript
# ----------------------------------------
watch_2 = Watch(python_add_js_rows)

string_12 = StringInput("""
    ]);
    drawChart(data, options)
}

function drawChart(data, options) {
    var chart = new google.visualization.PieChart(document.getElementById('chart'));
    chart.draw(data, options);
}
</script>""")
concat = String.Concat(string_7, string_8, code_block, string_9, string_10, string_11, watch_2, string_12)
string_13 = StringInput("""
<style>
#chart_wrap {
    position: relative;
    padding-bottom: 100%;
    overflow:hidden;
}
#chart {
    position: absolute;
    top: 0;
    left: 0;
    width:100%;
    height:100%;
}
</style>""")
concat_2 = String.Concat(concat, string_13)
string_14 = StringInput("""<div id="chart_wrap"><div id="chart"></div></div>
<p id="canvas_size"></p>""")

# group: Create HTML filename from category
string_15 = StringInput(".\")
string_16 = StringInput(".html")
concat_3 = String.Concat(string_15, string_from_object, string_16)
string_17 = StringInput(" ")
string_18 = StringInput("%20")
replace = String.Replace(str=string_from_object, searchFor=string_17, replaceWith=string_18)

# group: Write to external HTML file
generate_web_page = Custom[Generate Web Page](stylesheetSrc=create, javaScriptSrc=create_2, embeddedHeadCode=concat_2, content=string_14)  # Creates a static web page from a string formatted as HTML.
watch_3 = Watch(generate_web_page)
writeText = File.WriteText(concat_3, generate_web_page)

watch_4 = Watch(concat)

# group: Create data table
code_block_2 = CodeBlock { ""; }
string_19 = StringInput("data.addColumn('string', '")
string_20 = StringInput("');\n")
string_21 = StringInput("data.addColumn('number', 'Quantity');")
join = String.Join(code_block_2, string_19, string_from_object, string_20, string_21)
watch_5 = Watch(join)

javascript_google_pie_chart = Custom[JavaScript - Google Pie Chart]()  # Generate a JavaScript snippet to display a pie chart using Google Charts.; unwired: items, options
