# Dynamo graph Program Cube Generator.dyn (Dynamo 1.3.2.2480)

# note: Program Cube Generator
# ZGF Design Technology Group
# This Graph Requires Packages:
# Archi-lab
# Clockwork
# Lunchbox
excel_file_path = Filename(".\Program for Dynamo.xlsx")

# group: Import and Format Excel Data
fromPath = FileObject(excel_file_path)  # "File.FromPath"
sheet_name = StringInput("Sheet1")
boolean = BoolSelector(false)
readFromFile = Excel.ReadFromFile(file=fromPath, sheetName=sheet_name, readAsStrings=boolean)
transpose = List.Transpose(readFromFile)
start_row = CodeBlock { 4; }
code_block = CodeBlock(x=start_row) { x-1; }
dropItems = List.DropItems(list=transpose@L2, amount=code_block)
number_of_columns = CodeBlock { 7; }
sequence = Sequence(amount=number_of_columns, lacing=Longest)
getItemAtIndex = List.GetItemAtIndex(list=dropItems@L3, index=sequence)
watch = Watch(getItemAtIndex)

# group: Sort Data by Level
firstItem = List.FirstItem(watch@L3)
count = Count(firstItem@L2)
sequence_2 = Sequence(amount=count, lacing=Longest)
isNull = Object.IsNull(firstItem)
filterByBoolMask = List.FilterByBoolMask(list=sequence_2, mask=isNull)
restOfItems = List.RestOfItems(filterByBoolMask.out@L2)
code_block_2 = CodeBlock { 1; 0; }
shiftIndices = List.ShiftIndices(list=restOfItems@L2, amount=code_block_2.out0)
replaceItemAtIndex = List.ReplaceItemAtIndex(list=shiftIndices@L2, index=code_block_2.out1, item=code_block_2.out1)
sub = replaceItemAtIndex - restOfItems
abs = Math.Abs(sub)
sum = Math.Sum(abs)
sub_2 = count - sum
addItemToEnd = List.AddItemToEnd(item=sub_2, list=abs@L3)
flatten = Flatten(addItemToEnd)
chop = List.Chop(list=watch@L2, lengths=flatten)
watch_2 = Watch(chop)

# group: Sort by Department and Floor
restOfItems_2 = List.RestOfItems(watch_2@L4)
restOfItems_3 = List.RestOfItems(restOfItems_2@L2)
count_2 = Count(watch_2@L3)
chop_2 = List.Chop(list=restOfItems_3, lengths=count_2)
flatten_2 = Flatten(chop_2)
firstItem_2 = List.FirstItem(chop_2@L4)
count_3 = Count(firstItem_2@L2)
sequence_3 = Sequence(amount=count_3, lacing=Longest)
isNull_2 = Object.IsNull(firstItem_2)
filterByBoolMask_2 = List.FilterByBoolMask(list=sequence_3, mask=isNull_2@L3)
restOfItems_4 = List.RestOfItems(filterByBoolMask_2.out@L2)
code_block_3 = CodeBlock { 1; 0; }
shiftIndices_2 = List.ShiftIndices(list=restOfItems_4@L2, amount=code_block_3.out0)
replaceItemAtIndex_2 = List.ReplaceItemAtIndex(list=shiftIndices_2@L2, index=code_block_3.out1, item=code_block_3.out1)
sub_3 = replaceItemAtIndex_2 - restOfItems_4
abs_2 = Math.Abs(sub_3)
sum_2 = Math.Sum(abs_2)
sub_4 = count_3 - sum_2
addItemToEnd_2 = List.AddItemToEnd(item=sub_4@L1, list=abs_2@L2)
count_4 = Count(chop_2@L3)
count_5 = Count(count_4)
ofRepeatedItem = List.OfRepeatedItem(item=addItemToEnd_2, amount=count_5)
flatten_3 = Flatten(ofRepeatedItem)
chop_3 = List.Chop(list=flatten_2, lengths=flatten_3)
count_6 = Count(ofRepeatedItem@L2)
chop_4 = List.Chop(list=chop_3@L3, lengths=count_6)
count_7 = Count(ofRepeatedItem@L3)
chop_5 = List.Chop(list=chop_4@L4, lengths=count_7)
watch_3 = Watch(chop_5)

# group: Parse Excel Data
sqft_unit = CodeBlock { 2; }
getItemAtIndex_2 = List.GetItemAtIndex(list=watch_3@L5, index=sqft_unit)
isNull_3 = Object.IsNull(getItemAtIndex_2)
filterByBoolMask_3 = List.FilterByBoolMask(list=getItemAtIndex_2, mask=isNull_3)
color = CodeBlock { 4; }
getItemAtIndex_3 = List.GetItemAtIndex(list=watch_3@L5, index=color)
isNull_4 = Object.IsNull(getItemAtIndex_3)
filterByBoolMask_4 = List.FilterByBoolMask(list=getItemAtIndex_3, mask=isNull_4)
name = CodeBlock { 0; }
getItemAtIndex_4 = List.GetItemAtIndex(list=watch_3@L5, index=name)
isNull_5 = Object.IsNull(getItemAtIndex_4)
filterByBoolMask_5 = List.FilterByBoolMask(list=getItemAtIndex_4, mask=isNull_5)
color_2 = CodeBlock { 5; }
getItemAtIndex_5 = List.GetItemAtIndex(list=watch_3@L5, index=color_2)
color_3 = CodeBlock { 3; }
getItemAtIndex_6 = List.GetItemAtIndex(list=watch_3@L5, index=color_3)
isNull_6 = Object.IsNull(getItemAtIndex_6)
filterByBoolMask_6 = List.FilterByBoolMask(list=getItemAtIndex_5, mask=isNull_6)
filterByBoolMask_7 = List.FilterByBoolMask(list=getItemAtIndex_6, mask=isNull_6)
name_2 = CodeBlock { 1; }
getItemAtIndex_7 = List.GetItemAtIndex(list=watch_3@L5, index=name_2)
isNull_7 = Object.IsNull(getItemAtIndex_7)
filterByBoolMask_8 = List.FilterByBoolMask(list=getItemAtIndex_7, mask=isNull_7)

# group: Sort and Organize Data
isEmpty = List.IsEmpty(filterByBoolMask_4.out@L2)
count_8 = Count(filterByBoolMask_4.out@L3)
code_block_4 = CodeBlock { 1; }
max = Math.Max(value1=count_8, value2=code_block_4)
chop_6 = List.Chop(list=isEmpty, lengths=max)
filterByBoolMask_9 = List.FilterByBoolMask(list=filterByBoolMask_3.out@L3, mask=chop_6@L2)
filterByBoolMask_10 = List.FilterByBoolMask(list=filterByBoolMask_4.out@L3, mask=chop_6@L2)
boolean_2 = BoolSelector(true)
clean = List.Clean(list=filterByBoolMask_10.out, preserveIndices=boolean_2)
code_block_5 = CodeBlock { 0; }
eq = clean == code_block_5
filterByBoolMask_11 = List.FilterByBoolMask(list=filterByBoolMask_9.out, mask=eq)
name_of_room = Watch(filterByBoolMask_11.out)
filterByBoolMask_12 = List.FilterByBoolMask(list=filterByBoolMask_5.out@L3, mask=chop_6@L2)
clean_2 = List.Clean(list=filterByBoolMask_12.out, preserveIndices=boolean_2)
name_of_department = Watch(clean_2)
filterByBoolMask_13 = List.FilterByBoolMask(list=clean, mask=eq)
number_0f_rooms = Watch(filterByBoolMask_13.out)
filterByBoolMask_14 = List.FilterByBoolMask(list=filterByBoolMask_6.out@L3, mask=chop_6@L2)
filterByBoolMask_15 = List.FilterByBoolMask(list=filterByBoolMask_14.out, mask=eq)
room_dimension = Watch(filterByBoolMask_15.out)
filterByBoolMask_16 = List.FilterByBoolMask(list=filterByBoolMask_7.out@L3, mask=chop_6@L2)
filterByBoolMask_17 = List.FilterByBoolMask(list=filterByBoolMask_16.out, mask=eq)
sqft_room = Watch(filterByBoolMask_17.out)
filterByBoolMask_18 = List.FilterByBoolMask(list=filterByBoolMask_8.out@L3, mask=chop_6@L2)

isNull_8 = Object.IsNull()  # unwired: arg0

# group: Format Blocks
group_spacing = CodeBlock { 10; }
room_spacing = CodeBlock { 1; }
slab_thickness_inches = DoubleInput(7)

filterByBoolMask_19 = List.FilterByBoolMask(list=filterByBoolMask_18.out, mask=eq)

# group (continued): Sort and Organize Data
color_of_department = Watch(filterByBoolMask_19.out)

# group: Organize And Format Data
code_block_6 = CodeBlock { "null"; }
flatten_4 = Flatten(name_of_room@L2)
flatten_5 = Flatten(name_of_department)
uniqueItems = List.UniqueItems(flatten_5)
allIndicesOf = List.AllIndicesOf(list=flatten_5, item=uniqueItems)
watch_4 = Watch(allIndicesOf)
getItemAtIndex_8 = List.GetItemAtIndex(list=flatten_4, index=watch_4)
room_names = Watch(getItemAtIndex_8)
flatten_6 = Flatten(room_names@L3)
uniqueItems_2 = List.UniqueItems(flatten_6@L2)
count_9 = Count(uniqueItems_2@L2)
ofRepeatedItem_2 = List.OfRepeatedItem(item=code_block_6, amount=count_9)
count_10 = Count(room_names@L3)
ofRepeatedItem_3 = List.OfRepeatedItem(item=ofRepeatedItem_2@L2, amount=count_10, lacing=Longest)
allIndicesOf_2 = List.AllIndicesOf(list=uniqueItems_2@L2, item=flatten_6@L2)
flatten_7 = Flatten(allIndicesOf_2)
count_11 = Count(room_names@L2)
chop_7 = List.Chop(list=flatten_7, lengths=count_11)
count_12 = Count(room_names@L3)
chop_8 = List.Chop(list=chop_7@L3, lengths=count_12)
code_block_7 = CodeBlock { 1; }
flatten_8 = List.Flatten(list=chop_8, amt=code_block_7)
flatten_9 = Flatten(number_0f_rooms@L2)
getItemAtIndex_9 = List.GetItemAtIndex(list=flatten_9, index=watch_4)
number_of_rooms = Watch(getItemAtIndex_9)
replaceItemAtIndex_3 = Custom[List.ReplaceItemAtIndex](seq=ofRepeatedItem_3@L2, index=flatten_8@L2, replacement=number_of_rooms@L2)  # Replaces the item at a given index (or list of indices) of a list by another item
count_13 = Count(flatten_8@L3)
chop_9 = List.Chop(list=replaceItemAtIndex_3, lengths=count_13)
number_of_rooms_2 = Watch(chop_9)
sqrt = Math.Sqrt(number_of_rooms_2)
code_block_8 = CodeBlock { 0.49; }
add = sqrt + code_block_8
round = Math.Round(add)
number_of_rooms_width_side = Watch(round)
flatten_10 = Flatten(room_dimension@L2)
getItemAtIndex_10 = List.GetItemAtIndex(list=flatten_10, index=watch_4)
room_dimension_2 = Watch(getItemAtIndex_10)
replaceItemAtIndex_4 = Custom[List.ReplaceItemAtIndex](seq=ofRepeatedItem_3@L2, index=flatten_8@L2, replacement=room_dimension_2@L2)
chop_10 = List.Chop(list=replaceItemAtIndex_4, lengths=count_13)
input_room_widths = Watch(chop_10)
flatten_11 = Flatten(sqft_room@L2)
getItemAtIndex_11 = List.GetItemAtIndex(list=flatten_11, index=watch_4)
sqft_room_2 = Watch(getItemAtIndex_11)
replaceItemAtIndex_5 = Custom[List.ReplaceItemAtIndex](seq=ofRepeatedItem_3@L2, index=flatten_8@L2, replacement=sqft_room_2@L2)
chop_11 = List.Chop(list=replaceItemAtIndex_5, lengths=count_13)
room_area = Watch(chop_11)
sqrt_2 = Math.Sqrt(room_area)
replaceByCondition = Replace(input_room_widths, sqrt_2, isNull_8)
room_width = Watch(replaceByCondition)
mul = number_of_rooms_width_side * room_width
room_group_side_width = Watch(mul)
count_14 = Count(room_group_side_width@L3)
maximumItem = List.MaximumItem(count_14)
number_of_levels_total = Watch(maximumItem)
maximumItem_2 = List.MaximumItem(room_group_side_width@L4)
maximumItem_3 = List.MaximumItem(maximumItem_2@L2)
add_2 = maximumItem_3 + group_spacing
max_group_side_width = Watch(add_2)
sum_3 = Math.Sum(max_group_side_width)
group_side_width_total = Watch(sum_3)
div = number_of_rooms_2 / round
add_3 = code_block_8 + div
round_2 = Math.Round(add_3)
number_of_rooms_height_side = Watch(round_2)
room_height = CodeBlock(x=room_area, y=replaceByCondition) { x/y; }
room_height_2 = Watch(room_height)
mul_2 = number_of_rooms_height_side * room_height_2
room_group_side_height = Watch(mul_2)
transpose_2 = List.Transpose(room_group_side_height@L3)
maximumItem_4 = List.MaximumItem(transpose_2@L2)
count_15 = Count(transpose_2@L3)
chop_12 = List.Chop(list=maximumItem_4, lengths=count_15)
add_4 = chop_12 + group_spacing
max_group_side_height = Watch(add_4)
sum_4 = Math.Sum(max_group_side_height)
group_side_height_total = Watch(sum_4)
number_of_levels_per_group = Watch(count_14)
number_of_rooms_3 = Watch(number_of_rooms_2)
replaceItemAtIndex_6 = Custom[List.ReplaceItemAtIndex](seq=ofRepeatedItem_3@L2, index=flatten_8@L2, replacement=room_names@L2)
chop_13 = List.Chop(list=replaceItemAtIndex_6, lengths=count_13)
room_names_2 = Watch(chop_13)
getItemAtIndex_12 = List.GetItemAtIndex(list=flatten_5, index=watch_4)
department_names = Watch(getItemAtIndex_12)
flatten_12 = Flatten(color_of_department@L2)

# group: Level Organization
count_16 = Count(name_of_department@L3)
code_block_9 = CodeBlock { 0; }
eq_2 = count_16 == code_block_9
filterByBoolMask_20 = List.FilterByBoolMask(list=count_16, mask=eq_2)
count_17 = Count(filterByBoolMask_20.out)
sequence_4 = Sequence(amount=count_17, lacing=Longest)
count_18 = Count(name_of_room@L2)
chop_14 = List.Chop(list=count_18, lengths=filterByBoolMask_20.out)
ofRepeatedItem_4 = List.OfRepeatedItem(item=sequence_4, amount=chop_14, lacing=Longest)
flatten_13 = Flatten(ofRepeatedItem_4@L2)
getItemAtIndex_13 = List.GetItemAtIndex(list=flatten_13, index=watch_4)
level = Watch(getItemAtIndex_13)
uniqueItems_3 = List.UniqueItems(level@L2)
count_19 = Count(level@L3)
chop_15 = List.Chop(list=uniqueItems_3, lengths=count_19)
flatten_14 = Flatten(chop_15@L3)

# group: Levels and Block Heights
firstItem_3 = List.FirstItem(restOfItems_2@L2)
getItemAtIndex_14 = List.GetItemAtIndex(list=firstItem_3, index=sequence_4)
code_block_10 = CodeBlock { "'"; " "; }
replace = String.Replace(str=getItemAtIndex_14, searchFor=code_block_10.out0, replaceWith=code_block_10.out1)
toNumber = String.ToNumber(replace)
firstItem_4 = List.FirstItem(watch_2@L4)
boolean_3 = BoolSelector(false)
clean_3 = List.Clean(list=firstItem_4, preserveIndices=boolean_3)
flatten_15 = Flatten(clean_3)
getItemAtIndex_15 = List.GetItemAtIndex(list=flatten_15, index=sequence_4)
string_from_object = FromObject(getItemAtIndex_15)
byElevationAndName = Level.ByElevationAndName(toNumber, string_from_object)
getItemAtIndex_16 = List.GetItemAtIndex(list=byElevationAndName, index=level)
code_block_11 = CodeBlock(x=count_17) { x+1; }
sequence_5 = Sequence(amount=code_block_11, lacing=Longest)
getItemAtIndex_17 = List.GetItemAtIndex(list=firstItem_3, index=sequence_5)
code_block_12 = CodeBlock { -1; }
shiftIndices_3 = List.ShiftIndices(list=getItemAtIndex_17, amount=code_block_12)
replace_2 = String.Replace(str=shiftIndices_3, searchFor=code_block_10.out0, replaceWith=code_block_10.out1)
toNumber_2 = String.ToNumber(replace_2)
sub_5 = toNumber_2 - toNumber
code_block_13 = CodeBlock(x=slab_thickness_inches) { x/12; }
watch_5 = Watch(code_block_13)
sub_6 = sub_5 - watch_5

# group: Department Grid
byCoordinates = Point.ByCoordinates(z=toNumber)
XAxis = Vector.XAxis()
byStartPointDirectionLength = Line.ByStartPointDirectionLength(startPoint=byCoordinates, direction=XAxis, length=group_side_width_total)
code_block_14 = CodeBlock { 0; }
code_block_15 = CodeBlock { 1; }
count_20 = Count(max_group_side_width)
sequence_6 = Sequence(start=code_block_15, amount=count_20, lacing=Longest)
sequence_7 = Sequence(amount=sequence_6, lacing=Longest)
getItemAtIndex_18 = List.GetItemAtIndex(list=max_group_side_width, index=sequence_7)
sum_5 = Math.Sum(getItemAtIndex_18)
addItemToFront = List.AddItemToFront(item=code_block_14, list=sum_5@L2, lacing=CrossProduct)
dropLastItem = Custom[List.DropLastItem](list=addItemToFront)  # Drops the last item from a given list.
flatten_16 = Flatten(dropLastItem)
pointAtSegmentLength = Curve.PointAtSegmentLength(curve=byStartPointDirectionLength@L2, segmentLength=flatten_16, lacing=Longest)
getItemAtIndex_19 = List.GetItemAtIndex(list=pointAtSegmentLength@L2, index=flatten_14@L2)

# group: Room Group Grid
YAxis = Vector.YAxis()
byStartPointDirectionLength_2 = Line.ByStartPointDirectionLength(startPoint=getItemAtIndex_19, direction=YAxis, length=group_side_height_total)
code_block_16 = CodeBlock { 0; }
code_block_17 = CodeBlock { 1; }
count_21 = Count(max_group_side_height@L2)
sequence_8 = Sequence(start=code_block_17, amount=count_21, lacing=Longest)
sequence_9 = Sequence(amount=sequence_8, lacing=Longest)
getItemAtIndex_20 = List.GetItemAtIndex(list=max_group_side_height@L2, index=sequence_9@L3)
sum_6 = Math.Sum(getItemAtIndex_20)
addItemToFront_2 = List.AddItemToFront(item=code_block_16, list=sum_6, lacing=CrossProduct)
dropLastItem_2 = Custom[List.DropLastItem](list=addItemToFront_2)
ofRepeatedItem_5 = List.OfRepeatedItem(item=dropLastItem_2@L2, amount=number_of_levels_per_group, lacing=Longest)
pointAtSegmentLength_2 = Curve.PointAtSegmentLength(curve=byStartPointDirectionLength_2@L2, segmentLength=ofRepeatedItem_5@L3, lacing=Longest)

watch_6 = Watch(pointAtSegmentLength_2)

# group: Room Columns
XAxis_2 = Vector.XAxis()
reverse = Vector.Reverse(XAxis_2)
byStartPointDirectionLength_3 = Line.ByStartPointDirectionLength(startPoint=watch_6@L3, direction=XAxis_2, length=room_group_side_width@L3)
number_of_rooms_group_side = CodeBlock(x=number_of_rooms_width_side) { x; }
flatten_17 = Flatten(number_of_rooms_group_side@L2)
length = Curve.Length(byStartPointDirectionLength_3)
div_2 = length@L3 / number_of_rooms_group_side@L3
flatten_18 = Flatten(div_2@L2)
add_5 = flatten_18 + room_spacing
sequence_10 = Sequence(amount=flatten_17, step=add_5)
count_22 = Count(div_2@L3)
chop_16 = List.Chop(list=sequence_10@L4, lengths=count_22@L2)
pointAtSegmentLength_3 = Curve.PointAtSegmentLength(curve=byStartPointDirectionLength_3@L2, segmentLength=chop_16@L3, lacing=Longest)
count_23 = Count(byStartPointDirectionLength_3@L3)
chop_17 = List.Chop(list=pointAtSegmentLength_3, lengths=count_23)

watch_7 = Watch(chop_17)

# group: Room Group
YAxis_2 = Vector.YAxis()
room_group_side_length = CodeBlock(x=room_group_side_height) { x; }
byStartPointDirectionLength_4 = Line.ByStartPointDirectionLength(startPoint=watch_7@L3, direction=YAxis_2, length=room_group_side_length@L2)
count_24 = Count(watch_7@L4)
chop_18 = List.Chop(list=byStartPointDirectionLength_4, lengths=count_24)
flatten_19 = Flatten(number_of_rooms_height_side@L2)
length_2 = Curve.Length(chop_18)
average = Math.Average(length_2)
div_3 = average@L3 / number_of_rooms_height_side@L3
add_6 = div_3 + room_spacing
flatten_20 = Flatten(add_6@L2)
sequence_11 = Sequence(amount=flatten_19, step=flatten_20)
count_25 = Count(div_3@L3)
chop_19 = List.Chop(list=sequence_11@L4, lengths=count_25@L2)
count_26 = Count(chop_18@L2)
ofRepeatedItem_6 = List.OfRepeatedItem(item=chop_19@L2, amount=count_26@L1, lacing=Longest)
count_27 = Count(chop_18@L3)
chop_20 = List.Chop(list=ofRepeatedItem_6@L4, lengths=count_27)
count_28 = Count(chop_18@L4)
chop_21 = List.Chop(list=chop_20@L5, lengths=count_28)
pointAtSegmentLength_4 = Curve.PointAtSegmentLength(curve=chop_18@L2, segmentLength=chop_21@L3)
flatten_21 = Flatten(pointAtSegmentLength_4@L3)
chop_22 = List.Chop(list=flatten_21@L3, lengths=count_27)
chop_23 = List.Chop(list=chop_22@L4, lengths=count_28)

watch_8 = Watch(chop_23)

# group: Room Location Organization
X = Point.X(watch_8@L2)
groupByKey = List.GroupByKey(list=watch_8@L2, keys=X@L2)
Y = Point.Y(groupByKey.groups)
sortIndexByValue = SortIndexByValue(Y)
getItemAtIndex_21 = List.GetItemAtIndex(list=groupByKey.groups@L2, index=sortIndexByValue@L2)
count_29 = Count(groupByKey.groups@L3)
chop_24 = List.Chop(list=getItemAtIndex_21@L3, lengths=count_29@L2)
flatten_22 = Flatten(chop_24@L3)
count_30 = Count(chop_23@L3)
chop_25 = List.Chop(list=flatten_22@L3, lengths=count_30)
count_31 = Count(chop_23@L4)
chop_26 = List.Chop(list=chop_25@L4, lengths=count_31)
clean_4 = List.Clean(list=chop_26)
number_0f_rooms_2 = Watch(number_of_rooms_3)
count_32 = Count(number_0f_rooms_2@L2)
count_33 = Count(number_0f_rooms_2@L3)

flatten_23 = Flatten(number_0f_rooms_2)

# group (continued): Room Location Organization
sequence_12 = Sequence(amount=flatten_23, lacing=Longest)
getItemAtIndex_22 = List.GetItemAtIndex(list=clean_4@L2, index=sequence_12@L2)
chop_27 = List.Chop(list=getItemAtIndex_22, lengths=count_32)
chop_28 = List.Chop(list=chop_27@L4, lengths=count_33)

watch_9 = Watch(chop_28)
flatten_24 = Flatten(getItemAtIndex_16)
watch_10 = Watch(flatten_24)

# group: Room Levels
count_34 = Count(watch_9@L2)
isNull_9 = Object.IsNull(watch_9@L3)
firstItem_5 = List.FirstItem(isNull_9@L2)
filterByBoolMask_21 = List.FilterByBoolMask(list=count_34, mask=firstItem_5)
ofRepeatedItem_7 = List.OfRepeatedItem(item=watch_10@L1, amount=filterByBoolMask_21.out@L1)
code_block_18 = CodeBlock { "null"; }
count_35 = Count(filterByBoolMask_21.in@L2)
ofRepeatedItem_8 = List.OfRepeatedItem(item=code_block_18, amount=count_35)
flatten_25 = Flatten(ofRepeatedItem_8)
create = List.Create()  # unwired: arg0
map = List.Map(list=flatten_25, f_x=create)
create_2 = List.Create(ofRepeatedItem_7, map)
flatten_26 = Flatten(create_2@L2)
boolean_4 = BoolSelector(false)
allIndicesOf_3 = List.AllIndicesOf(list=firstItem_5, item=boolean_4)
boolean_5 = BoolSelector(true)
allIndicesOf_4 = List.AllIndicesOf(list=firstItem_5, item=boolean_5)
create_3 = List.Create(allIndicesOf_3, allIndicesOf_4)
flatten_27 = Flatten(create_3@L3)
sortByKey = List.SortByKey(list=flatten_26@L3, keys=flatten_27@L2)
flatten_28 = Flatten(sortByKey.sorted_list@L2)
count_36 = Count(watch_9@L3)
chop_29 = List.Chop(list=flatten_28@L3, lengths=count_36)
count_37 = Count(watch_9@L4)
chop_30 = List.Chop(list=chop_29@L4, lengths=count_37)

# group: Place Room Cubes
code_block_19 = CodeBlock { "Planning Cube"; }
byName = FamilyType.ByName(code_block_19)
byPointAndLevel = FamilyInstance.ByPointAndLevel(familyType=byName, point=watch_9@L2, level=chop_30@L2, lacing=Longest)
flatten_29 = Flatten(byPointAndLevel@L2)
count_38 = Count(watch_9@L3)
chop_31 = List.Chop(list=flatten_29@L3, lengths=count_38)
count_39 = Count(watch_9@L4)
chop_32 = List.Chop(list=chop_31@L4, lengths=count_39)

getItemAtIndex_23 = List.GetItemAtIndex(list=sub_6, index=level)
flatten_30 = Flatten(getItemAtIndex_23)
watch_11 = Watch(flatten_30)

# group: Room Heights
ofRepeatedItem_9 = List.OfRepeatedItem(item=watch_11@L1, amount=filterByBoolMask_21.out@L1)
create_4 = List.Create(ofRepeatedItem_9, map)
flatten_31 = Flatten(create_4@L2)
sortByKey_2 = List.SortByKey(list=flatten_31@L3, keys=flatten_27@L2)
flatten_32 = Flatten(sortByKey_2.sorted_list@L2)
chop_33 = List.Chop(list=flatten_32@L3, lengths=count_36)
chop_34 = List.Chop(list=chop_33@L4, lengths=count_37)

# group: Set Parameters
code_block_20 = CodeBlock { "Width"; }
setParameterByName = Element.SetParameterByName(element=chop_32@L4, parameterName=code_block_20, value=room_width@L3)
code_block_21 = CodeBlock { "Height"; }
setParameterByName_2 = Element.SetParameterByName(element=setParameterByName@L4, parameterName=code_block_21, value=chop_34@L4)
code_block_22 = CodeBlock { "Program Area"; }
setParameterByName_3 = Element.SetParameterByName(element=setParameterByName_2@L4, parameterName=code_block_22, value=room_area@L3)
code_block_23 = CodeBlock { "Room Name"; }
setParameterByName_4 = Element.SetParameterByName(element=setParameterByName_3@L4, parameterName=code_block_23, value=room_names_2@L3)
code_block_24 = CodeBlock { "Department Name"; }
setParameterByName_5 = Element.SetParameterByName(element=setParameterByName_4@L4, parameterName=code_block_24, value=department_names@L2, lacing=Longest)
code_block_25 = CodeBlock { "Offset"; 0; }
setParameterByName_6 = Element.SetParameterByName(element=setParameterByName_5@L4, parameterName=code_block_25.out0, value=code_block_25.out1)

getItemAtIndex_24 = List.GetItemAtIndex(list=flatten_12, index=watch_4)
levels = Watch(getItemAtIndex_24)

# group (continued): Organize And Format Data
replaceItemAtIndex_7 = Custom[List.ReplaceItemAtIndex](seq=ofRepeatedItem_3@L2, index=flatten_8@L2, replacement=levels@L2)
chop_35 = List.Chop(list=replaceItemAtIndex_7, lengths=count_13)
room_names_3 = Watch(chop_35)

# group: Set Color
flatten_33 = Flatten(setParameterByName_6@L2)
string = StringInput("Reporting Color")
parameterByName = Parameter.ParameterByName(element=flatten_33@L2, name=string, lacing=Longest)
flatten_34 = Flatten(room_names_3)
byName_2 = Material.ByName(flatten_34)
setValue = Parameter.SetValue(parameterByName@L3, byName_2@L2, lacing=Longest)

code_block_26 = CodeBlock { "null"; }
eq_3 = code_block_26 == _  # unwired: arg1

# group (continued): Level Organization
byLevel = FloorPlanView.ByLevel(byElevationAndName)  # frozen
getItemAtIndex_25 = List.GetItemAtIndex(list=byLevel, index=flatten_14@L2)
