# Dynamo graph Renumber Views 133 Simple.dyn (Dynamo 1.3.3.4111)

boolean = BoolSelector(true)

# group: Get Viewports from Active Sheet
python_active_view = Python(IN[0]=boolean)
# ---------- python_active_view.python (14 lines) ----------
#Copyright(c) 2016, Dimitar Venkov
# @5devene, dimitar.ven@gmail.com

import clr

clr.AddReference("RevitServices")
import RevitServices
from RevitServices.Persistence import DocumentManager
doc = DocumentManager.Instance.CurrentDBDocument
clr.AddReference("RevitNodes")
import Revit
clr.ImportExtensions(Revit.Elements)

OUT = doc.ActiveView.ToDSType(True)
# ----------------------------------------
viewports = archilab.Revit.Views.Sheet.Viewports(python_active_view)

watch = Watch(viewports)

# group: Generate Temporary Detail Number
code_block = CodeBlock { "Detail Number"; }
getParameterValueByName = Element.GetParameterValueByName(element=watch, parameterName=code_block)
code_block_2 = CodeBlock(Y=getParameterValueByName) { Y+"X"; }
setParameterByName = Element.SetParameterByName(element=watch, parameterName=code_block, value=code_block_2)

watch_2 = Watch(setParameterByName)

# group: Group Viewports by X
python_viewport_properties = Python(IN[0]=watch_2)
# ---------- python_viewport_properties.python (40 lines) ----------
# Copyright(c) 2015, Konrad K Sobon
# @arch_laboratory, http://archi-lab.net

import clr
clr.AddReference('ProtoGeometry')
from Autodesk.DesignScript.Geometry import *

# Import Element wrapper extension methods
clr.AddReference("RevitNodes")
import Revit
clr.ImportExtensions(Revit.Elements)

# Import geometry conversion extension methods
clr.ImportExtensions(Revit.GeometryConversion)

# Import DocumentManager and TransactionManager
clr.AddReference("RevitServices")
import RevitServices
from RevitServices.Persistence import DocumentManager
from RevitServices.Transactions import TransactionManager

doc = DocumentManager.Instance.CurrentDBDocument
uiapp = DocumentManager.Instance.CurrentUIApplication
app = uiapp.Application

#The inputs to this node will be stored as a list in the IN variables.
dataEnteringNode = IN

viewports = IN[0]

def ProcessList(_func, _list):
    return map( lambda x: ProcessList(_func, x) if type(x)==list else _func(x), _list )

def GetLocation(v):
	v = UnwrapElement(v)
	outline = v.GetBoxOutline()
	return outline.MinimumPoint.ToPoint()

#Assign your output to the OUT variable.
OUT = ProcessList(GetLocation, viewports)
# ----------------------------------------
X = Point.X(python_viewport_properties)
round = Math.Round(X)
sortByKey = List.SortByKey(list=watch_2, keys=round)
groupByKey = List.GroupByKey(list=sortByKey.sorted_list, keys=sortByKey.sorted_keys)

watch_3 = Watch(groupByKey.groups)

# group: Sort Viewports by Y
python_viewport_properties_2 = Python(IN[0]=watch_3)  # same code as python_viewport_properties
Y = Point.Y(python_viewport_properties_2)
sortByKey_2 = List.SortByKey(list=watch_3@L2, keys=Y@L2)

watch_4 = Watch(sortByKey_2.sorted_list)

# group: Reverse Order
flatten = Flatten(watch_4)
reverse = List.Reverse(flatten)

watch_5 = Watch(reverse)

# group: Generates Detail Numbers
count = Count(watch_5)
code_block_3 = CodeBlock(x=count) { 1..x; }

watch_6 = Watch(code_block_3)

# group: Write Final Detail Numbers
code_block_4 = CodeBlock { "Detail Number"; }
string_from_object = FromObject(watch_6)
setParameterByName_2 = Element.SetParameterByName(element=watch_5, parameterName=code_block_4, value=string_from_object)
