# Dynamo graph Renumber Views 133.dyn (Dynamo 1.3.3.4111)

refresh = BoolSelector(true)

# group: Get Current Sheet VIewports
python_active_view = Python(IN[0]=refresh)
# ---------- python_active_view.python (14 lines) ----------
#Copyright(c) 2016, Dimitar Venkov
# @5devene, dimitar.ven@gmail.com

import clr

clr.AddReference("RevitServices")
import RevitServices
from RevitServices.Persistence import DocumentManager
doc = DocumentManager.Instance.CurrentDBDocument
clr.AddReference("RevitNodes")
import Revit
clr.ImportExtensions(Revit.Elements)

OUT = doc.ActiveView.ToDSType(True)
# ----------------------------------------
viewports = archilab.Revit.Views.Sheet.Viewports(python_active_view)
flatten = Flatten(viewports)

# group: Generate Temporary Detail Number
code_block = CodeBlock { "Detail Number"; }
getParameterValueByName = Element.GetParameterValueByName(element=flatten, parameterName=code_block)
code_block_2 = CodeBlock(x=getParameterValueByName) { x+"DUP"; }
setParameterByName = Element.SetParameterByName(element=flatten, parameterName=code_block, value=code_block_2)

down_then_left_0_left_then_down = DoubleSlider(2, range=0..3 step 1)  # "Down then Left [0], Left then Down [1], Down then Right [2], Right then Down [3]"

# group: Pre-configured Patterns
boolean = BoolSelector(false)
create = List.Create(boolean, boolean, boolean)
boolean_2 = BoolSelector(true)
create_2 = List.Create(boolean_2, boolean, boolean)
create_3 = List.Create(boolean, boolean_2, boolean_2)
create_4 = List.Create(boolean_2, boolean_2, boolean)
create_5 = List.Create(create, create_2, create_3, create_4)
getItemAtIndex = List.GetItemAtIndex(list=create_5, index=down_then_left_0_left_then_down)
watch = Watch(getItemAtIndex)
code_block_3 = CodeBlock(x=watch) { x[0]; }
watch_2 = Watch(code_block_3)
code_block_4 = CodeBlock(x=watch) { x[1]; }
watch_3 = Watch(code_block_4)
code_block_5 = CodeBlock(x=watch) { x[2]; }
watch_4 = Watch(code_block_5)

# group: Group by Row or Column
python_viewport_location = Python(IN[0]=flatten)
# ---------- python_viewport_location.python (40 lines) ----------
# Copyright(c) 2015, Konrad K Sobon
# @arch_laboratory, http://archi-lab.net

import clr
clr.AddReference('ProtoGeometry')
from Autodesk.DesignScript.Geometry import *

# Import Element wrapper extension methods
clr.AddReference("RevitNodes")
import Revit
clr.ImportExtensions(Revit.Elements)

# Import geometry conversion extension methods
clr.ImportExtensions(Revit.GeometryConversion)

# Import DocumentManager and TransactionManager
clr.AddReference("RevitServices")
import RevitServices
from RevitServices.Persistence import DocumentManager
from RevitServices.Transactions import TransactionManager

doc = DocumentManager.Instance.CurrentDBDocument
uiapp = DocumentManager.Instance.CurrentUIApplication
app = uiapp.Application

#The inputs to this node will be stored as a list in the IN variables.
dataEnteringNode = IN

viewports = IN[0]

def ProcessList(_func, _list):
    return map( lambda x: ProcessList(_func, x) if type(x)==list else _func(x), _list )

def GetLocation(v):
	v = UnwrapElement(v)
	outline = v.GetBoxOutline()
	return outline.MinimumPoint.ToPoint()

#Assign your output to the OUT variable.
OUT = ProcessList(GetLocation, viewports)
# ----------------------------------------
X = Point.X(python_viewport_location)
Y = Point.Y(python_viewport_location)
create_6 = List.Create(X, Y)
countTrue = CountTrue(watch_2)
getItemAtIndex_2 = List.GetItemAtIndex(list=create_6, index=countTrue)
round = Math.Round(getItemAtIndex_2)
sortByKey = List.SortByKey(list=setParameterByName, keys=round)
groupByKey = List.GroupByKey(list=sortByKey.sorted_list, keys=sortByKey.sorted_keys)

watch_5 = Watch(groupByKey.groups)

# group: Sort Within Group
python_viewport_location_2 = Python(IN[0]=watch_5)  # same code as python_viewport_location
Y_2 = Point.Y(python_viewport_location_2)
X_2 = Point.X(python_viewport_location_2)
create_7 = List.Create(Y_2, X_2)
countTrue_2 = CountTrue(watch_2)
getItemAtIndex_3 = List.GetItemAtIndex(list=create_7, index=countTrue_2)
round_2 = Math.Round(getItemAtIndex_3)
sortByKey_2 = List.SortByKey(list=watch_5@L2, keys=round_2@L2)

watch_6 = Watch(sortByKey_2.sorted_list)

# group: Reverse Group Order
flatten_2 = Flatten(watch_6)
reverse = List.Reverse(watch_6@L2)
flatten_3 = Flatten(reverse)
create_8 = List.Create(flatten_2, flatten_3)
countTrue_3 = CountTrue(watch_3)
getItemAtIndex_4 = List.GetItemAtIndex(list=create_8, index=countTrue_3)
reverse_2 = List.Reverse(getItemAtIndex_4)

watch_7 = Watch(reverse_2)
letters = BoolSelector(false)

# group: Letter option
flatten_4 = Flatten(watch_7)
count = Count(flatten_4)
code_block_6 = CodeBlock(x=count) { 1..x; }
code_block_7 = CodeBlock { "A".."Z"; }
code_block_8 = CodeBlock { ""; }
split = String.Split(code_block_7, code_block_8)
flatten_5 = Flatten(split)
code_block_9 = CodeBlock(x=count) { 0..(x-1); }
getItemAtIndex_5 = List.GetItemAtIndex(list=flatten_5, index=code_block_9)
create_9 = List.Create(code_block_6, getItemAtIndex_5)
countTrue_4 = CountTrue(letters)
getItemAtIndex_6 = List.GetItemAtIndex(list=create_9, index=countTrue_4)

watch_8 = Watch(getItemAtIndex_6)

# group: Reverse Order
reverse_3 = List.Reverse(watch_8)
create_10 = List.Create(watch_8, reverse_3)
countTrue_5 = CountTrue(watch_4)
getItemAtIndex_7 = List.GetItemAtIndex(list=create_10, index=countTrue_5)

watch_9 = Watch(getItemAtIndex_7)

# group: Write Detail Number
code_block_10 = CodeBlock { "Detail Number"; }
string_from_object = FromObject(watch_9)
setParameterByName_2 = Element.SetParameterByName(element=flatten_4, parameterName=code_block_10, value=string_from_object)
