# Dynamo graph Get Spaces.dyn (Dynamo 0.9.1.4062)

categories = Categories("DataDevices")
all_elements_of_category = ElementsOfCategory(categories)
categories_2 = Categories("CommunicationDevices")
all_elements_of_category_2 = ElementsOfCategory(categories_2)
categories_3 = Categories("TelephoneDevices")
all_elements_of_category_3 = ElementsOfCategory(categories_3)
join = List.Join(all_elements_of_category, all_elements_of_category_2, all_elements_of_category_3)

# group: Pick a space
select_model_element = DSModelElementSelection()  # 1 picked in the model

geometry = Element.Geometry(select_model_element)
boolean = BoolSelector(false)
clean = List.Clean(list=geometry, preserveIndices=boolean)
byGeometry = BoundingBox.ByGeometry(clean)
location = FamilyInstance.Location(join)
contains = BoundingBox.Contains(byGeometry, location)
filterByBoolMask = List.FilterByBoolMask(list=join, mask=contains)
code_block = CodeBlock { "Location"; }
code_block_2 = CodeBlock { "Number"; }
getParameterValueByName = Element.GetParameterValueByName(element=select_model_element, parameterName=code_block_2)
setParameterByName = Element.SetParameterByName(element=filterByBoolMask.in, parameterName=code_block, value=getParameterValueByName)
