# Dynamo graph GetData.dyn (Dynamo 1.3.0.875)

categories = Categories("DuctCurves")

# group: Get all elements and their parameters
all_elements_of_category = ElementsOfCategory(categories)
parameters = Element.Parameters(all_elements_of_category)
watch = Watch(parameters)

# group: Get parameter values
value = Parameter.Value(parameters)
watch_2 = Watch(value)
string_from_object = FromObject(watch_2)
string = StringInput("ø")
string_2 = StringInput("Diameter")
list_of_lists_of_lists_of_values = String.Replace(str=string_from_object, searchFor=string, replaceWith=string_2)
watch_3 = Watch(list_of_lists_of_lists_of_values)

# group: Get parameter names
name = Parameter.Name(parameters)
watch_4 = Watch(name)

# group: Gets one parameter value. To-do: get all elements and their parameter values
py_create_dictionary = Python(IN[0]=watch_3, IN[1]=watch_4)
# ---------- py_create_dictionary.python (15 lines) ----------
import clr
clr.AddReference('ProtoGeometry')
from Autodesk.DesignScript.Geometry import *
#The inputs to this node will be stored as a list in the IN variables.

values = IN[0]
keys = IN[1]

#myDic = [dict(zip(keys[0], values[0])) for i in keys[0]]
	
myDic = dict(zip(keys[0],values[0]))

#Assign your output to the OUT variable.
#OUT = myDic["Width"]
OUT = myDic["Width"]
# ----------------------------------------
watch_5 = Watch(py_create_dictionary)

file_path = Filename("..\..\DB\Future\Mechanical.db")
boolean = BoolSelector(true)
SQLite_Command = Database.Command.SQLite_Command(file_path, boolean)  # unwired: arg2
