# Dynamo graph Sheet Set from Excel.dyn (Dynamo 1.3.0.875)

# group: Read Me
# note: Note: Currently users must manually delete sheet set in Revit if needs to be updated. Looking for suggestions on how to modify Python code to check if sheet set exists and delete.

# group: Set File Path to Excel file
file_path = Filename(".\Sample Drawing List.xlsx")

# group: Set your worksheet name in Excel file
worksheet_name = CodeBlock { "Sheet1"; }

# group: Get data from Excel
fromPath = FileObject(file_path)  # "File.FromPath"
boolean = BoolSelector(true)
readFromFile = Excel.ReadFromFile(file=fromPath, sheetName=worksheet_name, readAsStrings=boolean)
watch = Watch(readFromFile)

# group: Skip header rows: Set this to the list number in previous node where the sheets start
code_block = CodeBlock { 3; }

# group: Create list of sheet rows (skip header rows)
code_block_2 = CodeBlock { 1; }
sublists = List.Sublists(list=watch, ranges=code_block, offset=code_block_2)
watch_2 = Watch(sublists)
code_block_3 = CodeBlock { 1; }
flatten = List.Flatten(list=watch_2, amt=code_block_3)
watch_3 = Watch(flatten)

# group: Set this to the column number to search for null values. The previous node is a good help to find the latest mark.
column_number = CodeBlock { 4; }

# group: Get rows that are not null
python_returns_rows_are_not_null = Python(IN[0]=watch_3, IN[1]=column_number)
# ---------- python_returns_rows_are_not_null.python (15 lines) ----------
import clr
clr.AddReference('ProtoGeometry')
from Autodesk.DesignScript.Geometry import *
#The inputs to this node will be stored as a list in the IN variables.
listIn = IN[0]
columnNumber = IN[1]
listOut = []

#Output list of sheets only when there is an "x" in column 8
for sheet in listIn:
	if sheet[columnNumber] != None:
		listOut.append(sheet)

#Assign your output to the OUT variable.
OUT = listOut
# ----------------------------------------
count = List.Count(python_returns_rows_are_not_null)

# group: Set the column number of the sheet numbers in the Excel file
code_block_4 = CodeBlock { 0; }

# group: Create list of sheet numbers
python_return_sheet_numbers_only = Python(IN[0]=python_returns_rows_are_not_null, IN[1]=code_block_4)
# ---------- python_return_sheet_numbers_only.python (16 lines) ----------
import clr
clr.AddReference('ProtoGeometry')
from Autodesk.DesignScript.Geometry import *
#The inputs to this node will be stored as a list in the IN variables.
listIn = IN[0]
sheetNumberColumn = IN[1]

drawingNumbers = []


for index, i in enumerate(listIn):
	drawingNumbers.append(listIn[index][sheetNumberColumn])

#Assign your output to the OUT variable.
#OUT = listIn
OUT = drawingNumbers
# ----------------------------------------
watch_4 = Watch(python_return_sheet_numbers_only)

# group: Get sheets as elements
categories = Categories("Sheets")
all_elements_of_category = ElementsOfCategory(categories)
sheetNumber = Sheet.SheetNumber(all_elements_of_category)
python_script = Python(IN[0]=sheetNumber, IN[1]=all_elements_of_category, IN[2]=watch_4)
# ---------- python_script.python (11 lines) ----------
import clr
clr.AddReference('ProtoGeometry')
from Autodesk.DesignScript.Geometry import *
#The inputs to this node will be stored as a list in the IN variables.
allSheetNumbers = IN[0]
elements = IN[1]
filteredSheetNumbers = IN[2]
dict1 = dict(zip(allSheetNumbers,elements))

#Assign your output to the OUT variable.
OUT = [dict1[v] for v in filteredSheetNumbers]
# ----------------------------------------

# group: Define the sheet set name for printing in Revit
code_block_5 = CodeBlock { "Construction Documents"; }

# group: Create sheet set in Revit
python_create_sheet_set = Python(IN[0]=python_script, IN[1]=code_block_5)
# ---------- python_create_sheet_set.python (53 lines) ----------
import clr
clr.AddReference('ProtoGeometry')
from Autodesk.DesignScript.Geometry import *

clr.AddReference('RevitAPI')
import Autodesk
from Autodesk.Revit.DB import *

clr.AddReference('RevitServices')
import RevitServices
from RevitServices.Persistence import DocumentManager
from RevitServices.Transactions import TransactionManager

doc = DocumentManager.Instance.CurrentDBDocument

sheets = IN[0]
sheetSetName = IN[1]

viewSet = ViewSet()

# try to add all of the sheets to the set
try:
 	for vs in sheets:
 		view = UnwrapElement(vs)
 		viewSet.Insert(view)
# If there’s one item in the set, just add the one
except:
 	view = UnwrapElement(sheets)
 	viewSet.Insert(view)

# Get the printmanager to add the view set to.
printManager = doc.PrintManager
printManager.PrintRange = PrintRange.Select

# create the ViewSheetSetting to append the viewset.
viewSheetSetting = printManager.ViewSheetSetting
viewSheetSetting.CurrentViewSheetSet.Views = viewSet

# Create the Sheet Set
trans = Transaction(doc, 'Create View/Sheet Set')

TransactionManager.Instance.ForceCloseTransaction()

trans.Start()
try:
 	viewSheetSetting.SaveAs(sheetSetName)
 	msg = 'Sheet set ' + sheetSetName + ' created.'
except:
 	msg = 'Failed to create sheet set'
trans.Commit()

#Assign your output to the OUT variable
OUT = msg
# ----------------------------------------
